# Grasshopper definition 03_three_phase_daylight_analysis.gh (Grasshopper 0.9.76)
# plug-ins: Python Interpreter

panel = Panel("C:\Users\Administrator\Documents\GitHub\honeybee\tests\room\xmls\clear.xml")
radbsdfmaterial = HoneybeePlus_RadianceBSDFMaterial(xmlfile=panel, upOrientation=Vector(0.01, 0.01, 1), thickness=0)  # -> material; plug-in component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
radopaquematerial = HoneybeePlus_RadianceOpaqueMaterial(name="wall", reflect=".55", spec=0, rough=0)  # -> material; plug-in component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
panel_2 = Panel("""1
2
3
4
5""")
radglassmaterial = HoneybeePlus_RadianceGlassMaterial(name="g_material", TVis=".6")  # -> material; plug-in component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
brep = Brep(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)
brep_2 = Brep(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)
panel_3 = Panel(radopaquematerial)
wires = BrepWireframe(Brep=brep_2, Density=-1)
gentestpts = Honeybee_GenerateTestPoints(testGeometry=brep_2, gridSize=".5", distBaseSrf=Slider(0.762, range=0..1), moveTestMesh=True)  # -> readMe, simplify(testPoints), simplify(ptsVectors), simplify(facesArea), simplify(mesh); plug-in component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
panel_4 = Panel(radglassmaterial)
preview = CustomPreview(Geometry=brep, Shader=ColourSwatch(SwatchColor=RGBA(211, 208, 255, 64)))
wires_2 = BrepWireframe(Brep=brep, Density=-1)
brep_3 = Brep([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])

# ---- group: change the path to honeybeex folder
panel_5 = Panel("""C:\Users\Administrator\Documents\GitHub\honeybee
C:\Users\Administrator\Documents\GitHub\honeybee-plus""")
python = PythonScript(path_to_honeybee_libs=panel_5)  # -> readMe; inputs path_to_honeybee_libs: list
# ---------- python: Python ----------
import sys

if path_to_honeybee_libs:
    for p in path_to_honeybee_libs:
        sys.path.append(p)

import honeybee_grasshopper
import honeybee
import honeybee.hbsurface
# ---------- end python ----------

# ----
wires_3 = BrepWireframe(Brep=brep_3, Density=-1)
brep_4 = Brep(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)
hbsurface = HoneybeePlus_HoneybeeSurface(geo=brep, name="glass_wall", radMat=radbsdfmaterial)  # -> readMe, HBSrf; plug-in component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
points = PointList(Points=gentestpts.testPoints)
python_2 = PythonScript()  # -> out, a
# ---------- python_2: Python ----------
import os

print os.path.split(r'c:\\ladybug\\name.txt')
# ---------- end python_2 ----------
path = FilePath("C:\EnergyPlusV8-3-0\WeatherData\USA_CA_San.Francisco.Intl.AP.724940_TMY3.epw")
debrep = DeconstructBrep(Brep=brep_4)  # -> Faces, Edges, Vertices

# ---- group: visualizeGeometry
python_3 = PythonScript(HBObjs=hbsurface.HBSrf)  # -> geo; inputs HBObjs: list
# ---------- python_3: Python ----------
geo = (hbo.geometry for hbo in HBObjs if hasattr(hbo, 'geometry'))
# ---------- end python_3 ----------

# ----
hbsurface_2 = HoneybeePlus_HoneybeeSurface(geo=brep_3, name=panel_2, radMat=radopaquematerial)  # -> readMe, HBSrf; plug-in component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
hbsurface_3 = HoneybeePlus_HoneybeeSurface(geo=debrep.Faces)  # -> readMe, HBSrf; plug-in component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

# ---- group: analysis recipe
annualrecipe = HoneybeePlus_AnnualDaylightRecipe(epwFile=path, testPoints=gentestpts.testPoints, ptsVectors=gentestpts.ptsVectors, skyDensity=1)  # -> analysisRecipe; plug-in component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

# ----
panel_6 = Panel(annualrecipe)
panel_7 = Panel(hbsurface_2.HBSrf)
panel_8 = Panel("test room")
analysisgrid = HoneybeePlus_AnalysisGrid(testPoints=gentestpts.testPoints)  # -> analysisGrid; plug-in component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

# ---- group: we can check if it has changed
skymtx = PythonScript()

# ----
data = Data(flatten([hbsurface.HBSrf, hbsurface_2.HBSrf, hbsurface_3.HBSrf]))
toggle = BooleanToggle(False)
runradiance = HoneybeePlus_RunRadianceAnalysis(analysisRecipe=annualrecipe, HBObjects=data, folder="c:\ladybug", name="untitled", write=toggle, run=toggle)  # -> readMe, results; plug-in component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
threephaserecipe = HoneybeePlus_ThreePhaseDaylightRecipe(skyMTX=skymtx, analysisGrid=analysisgrid, reuseDMTX=True)  # -> analysisRecipe; plug-in component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
number_slider = Slider(10000, range=0..10000)
panel_9 = Panel("100")

# ---- group: get daylight autonomy
python_4 = PythonScript(results=runradiance.results, workingHours="9 To 17", threshold=300, minUsefulIllum=100, maxUsefulIllum=2000)  # -> DA, CDA, UDI, less, more; inputs results: list, threshold: Int32, minUsefulIllum: Int32, maxUsefulIllum: Int32
# ---------- python_4: Python ----------
if _results and _results[0]:
    stTime, endTime = _workingHours_
    _DA = [0] * len(_results[0])
    _CDA = [0] * len(_results[0])
    _UDI =  [0] * len(_results[0])
    _less =  [0] * len(_results[0])
    _more =  [0] * len(_results[0])
    nOfHours = 0
    for HOY, result in enumerate(_results):
        if not stTime <= HOY % 24 < endTime:
            continue
        nOfHours += 1
        for ptCount, ill in enumerate(result):
            _ill = float(ill)
            if _ill >= _threshold_:
                _DA[ptCount] += 1
                _CDA[ptCount] += 1
            else:
                _CDA[ptCount] += _ill /_threshold_
            
            if _ill < _minUsefulIllum_:
                _less[ptCount] += 1
            elif _ill > _maxUsefulIllum_:
                _more[ptCount] += 1
            else:
                _UDI[ptCount] += 1
    
    # divide values by the number of hours
    DA = (v / nOfHours * 100 for v in _DA)
    CDA = (v / nOfHours * 100 for v in _CDA)
    UDI = (v / nOfHours * 100 for v in _UDI)
    less = (v / nOfHours * 100 for v in _less)
    more = (v / nOfHours * 100 for v in _more)
# ---------- end python_4 ----------

# ---- group: get annual results for an hour of year
python_5 = PythonScript(results=runradiance.results, hoy="15")  # -> illuminance; inputs results: list, hoy: Int32
# ---------- python_5: Python ----------
if _results and _results[0] and _hoy:
    illuminance = (float(i) for i in _results[_hoy])
# ---------- end python_5 ----------

# ----
legendpar = Ladybug_LegendParameters(highBound="100")  # -> legendPar; plug-in component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
recolormesh = Ladybug_RecolorMesh(analysisResult=python_4.DA, inputMesh=gentestpts.mesh)  # -> readMe, newMesh, newLegend, legendBasePt, meshColors, legendColors; plug-in component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
ladybug = Ladybug_Ladybug()  # -> Vviiiiiiiiiizzz; plug-in component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
