# Grasshopper definition 05_three_phase_daylight_analysis.gh (Grasshopper 0.9.76)
# plug-ins: Python Interpreter

panel = Panel("C:\Users\Mostapha\Documents\code\ladybug-analysis-tools\honeybee\tests\room\xmls\clear.xml")
panel_2 = Panel("C:\Users\Mostapha\Documents\code\ladybug-analysis-tools\honeybee\tests\room\xmls\diffuse50.xml")
panel_3 = Panel("C:\Users\Mostapha\Documents\code\ladybug-analysis-tools\honeybee\tests\room\xmls\clear.xml")
radbsdfmaterial = HoneybeePlus_RadianceBSDFMaterial(xmlfile=panel_3, upOrientation=Vector(0.01, 0.01, 1), thickness=0)  # -> material; plug-in component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
brep = Brep([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])
brep_2 = Brep(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)
panel_4 = Panel("""north_glass_1
north_glass_2""")
path = FilePath("C:\EnergyPlusV8-6-0\WeatherData\USA_VA_Sterling-Washington.Dulles.Intl.AP.724030_TMY3.epw")
wires = BrepWireframe(Brep=brep, Density=-1)
preview = CustomPreview(Geometry=brep, Shader=ColourSwatch(SwatchColor=RGBA(211, 208, 255, 64)))
preview_2 = CustomPreview(Geometry=brep_2, Shader=ColourSwatch(SwatchColor=RGBA(211, 208, 255, 64)))
wea = HoneybeePlus_Wea(epwFile=path)  # -> wea; plug-in component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
radbsdfmaterial_2 = HoneybeePlus_RadianceBSDFMaterial(xmlfile=[panel, panel_2], upOrientation=Vector(0.01, 0.01, 1), thickness=0)  # -> material; plug-in component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
hbwinsrf = HoneybeePlus_HoneybeeWindowSurface(geo=brep, name=panel_4)  # -> readMe, HBWindowSrf; plug-in component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

# ---- group: This window will be it's own group
hbwinsrf_2 = HoneybeePlus_HoneybeeWindowSurface(geo=brep_2, name="skylight", radMat=radbsdfmaterial)  # -> readMe, HBWindowSrf; plug-in component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

# ----
brep_3 = Brep(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)
gentestpts = Honeybee_GenerateTestPoints(testGeometry=brep_3, gridSize="2", distBaseSrf=Slider(0.762, range=0..1), moveTestMesh=True)  # -> readMe, simplify(testPoints), simplify(ptsVectors), simplify(facesArea), simplify(mesh); plug-in component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
panel_5 = Panel("""12
13
14
15""")
wires_2 = BrepWireframe(Brep=brep_3, Density=-1)
brep_4 = Brep([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])
wires_3 = BrepWireframe(Brep=brep_4, Density=-1)
panel_6 = Panel("""1
2
3
4
5
6""")
skymatrix = HoneybeePlus_SkyMatrix(north=0, wea=wea, skyDensity=1, hoys=panel_5)  # -> skyMTX; plug-in component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
skyvector = HoneybeePlus_SkyVector(north=0, wea=wea, month="6", day=21, hour="6")  # -> skyVec; plug-in component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
points = PointList(Points=gentestpts.testPoints)
hbwindowgroup = HoneybeePlus_HoneybeeWindowGroup(name="group_1", bsdfMaterials=radbsdfmaterial_2, HBWindowSrfs=hbwinsrf.HBWindowSrf)  # -> HBWindowGroup; plug-in component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
preview_3 = CustomPreview(Geometry=wires_3, Shader=ColourSwatch(SwatchColor=RGB(0, 0, 0)))
analysisgrid = HoneybeePlus_AnalysisGrid(testPoints=gentestpts.testPoints)  # -> analysisGrid; plug-in component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

# ---- group: context!
brep_5 = Brep([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])
debrep = DeconstructBrep(Brep=brep_5)  # -> flatten(Faces), Edges, Vertices
hbsurface = HoneybeePlus_HoneybeeSurface(geo=debrep.Faces)  # -> readMe, HBSrf; plug-in component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

# ----
hbsurface_2 = HoneybeePlus_HoneybeeSurface(geo=brep_4, name=panel_6)  # -> readMe, HBSrf; plug-in component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
threephasegbrecipe = HoneybeePlus_GridBasedThreePhaseDaylightRecipe(skyMTX=skymatrix, analysisGrid=analysisgrid, analysisType=0, reuseViewMTX=True, reuseDaylightMTX=True)  # -> analysisRecipe; plug-in component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
hbtorad = HoneybeePlus_WriteHBObjectsToRadiance(hbObjects=hbsurface.HBSrf, folder="c:\ladybug\untitled", filename="threePhase_context", write=Toggle(True))  # -> radFile; plug-in component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
radscene = HoneybeePlus_RadianceScene(radFiles=hbtorad, copyLocal=True, overwrite=False)  # -> radScene; plug-in component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
panel_7 = Panel(threephasegbrecipe)

# ---- group: visualizeGeometry
python = PythonScript()  # -> geo; inputs HBObjs: list
# ---------- python: Python ----------
geo = (hbo.geometry for hbo in HBObjs if hasattr(hbo, 'geometry'))
# ---------- end python ----------

# ----
data = Data(flatten([hbsurface_2.HBSrf, hbwindowgroup, hbwinsrf_2.HBWindowSrf]))
toggle = BooleanToggle(False)
runradiance = HoneybeePlus_RunRadianceAnalysis(
    analysisRecipe=threephasegbrecipe,
    HBObjects=data,
    radScene=radscene,
    folder="c:\ladybug",
    name="workshop",
    write=toggle,
    run=toggle)  # -> readMe, results; plug-in component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
python_2 = PythonScript(ar=threephasegbrecipe)  # -> numOfHours
# ---------- python_2: Python ----------
try:
    numOfHours = len(ar.skyMatrix.hoys)
except AttributeError:
    numOfHours = 1
# ---------- end python_2 ----------

# ---- group: pick the state for group 1
number_slider = Slider(1, range=0..1)

# ----
partition = PartitionList(List=runradiance.results, Size=python_2)  # -> simplify(Chunks)
branch = TreeBranch(Tree=partition, Path="{2}", MaintainPaths=False)
branch_2 = TreeBranch(Tree=partition, Path=number_slider, MaintainPaths=False)
entwine = Entwine(Branch00=branch_2, Branch01=branch, FlattenInputs=True)
legendpar = Ladybug_LegendParameters(lowBound="0", highBound="2000")  # -> legendPar; plug-in component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

# ---- group: get annual results for an hour of year
python_3 = PythonScript(results=entwine, hoy=Slider(0, range=0..10))  # -> illuminance; inputs results: list, hoy: Int32
# ---------- python_3: Python ----------
if _results and _results[0] and _hoy is not None:
    illuminance = (float(i) for i in _results[_hoy % len(_results)])
# ---------- end python_3 ----------

# ----
panel_8 = Panel("""Total
Group I Contribution
Skylight Contribution""")
bang = ExplodeTree(Data=python_3)  # -> Branch0, Branch1
addition = Addition(A=bang.Branch0, B=bang.Branch1)
entwine_2 = Entwine(Branch00=addition, Branch01=bang.Branch0, Branch02=bang.Branch1, FlattenInputs=True)
graft = GraftTree(Tree=panel_8, IncludeEmptyLists=True, IncludeNullItems=True)
recolormesh = Ladybug_RecolorMesh(analysisResult=entwine_2, inputMesh=gentestpts.mesh, legendPar=legendpar, analysisTitle=graft, legendTitle="lux")  # -> readMe, newMesh, newLegend, legendBasePt, meshColors, legendColors; plug-in component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
ladybug = Ladybug_Ladybug()  # -> Vviiiiiiiiiizzz; plug-in component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
panel_9 = Panel("""0
20
20""")
panel_10 = Panel("""0
7
-7""")
vec = VectorXYZ(XComponent=panel_9, YComponent=panel_10, ZComponent=0)  # -> graft(Vector), Length
move = Move(Geometry=recolormesh.newLegend, Motion=vec.Vector)  # -> Geometry, Transform
move_2 = Move(Geometry=recolormesh.newMesh, Motion=vec.Vector)  # -> Geometry, Transform
