# Grasshopper definition analysisRecipe.gh (Grasshopper 0.9.76)
# plug-ins: Python Interpreter

planesrf = PlaneSurface(Plane=PlaneXY(0, 0, 0), XSize="20", YSize="20")

# ---- group: Radiance parameters
radpar = PythonScript(quality=Slider(2, range=0..10))  # -> radParameters; inputs quality: Int32, ab: Int32, ad: Int32, as: Int32, ar: Int32
# ---------- radpar: Python ----------
import sys
sys.path.append(r"C:\Users\Administrator\Documents\GitHub\honeybee-grasshopper")

from honeybeegrasshopper.radiance import parameters
from honeybeegrasshopper import wrapper

if _quality:
    radParameters = parameters.RadianceParameters(_quality)
    if _ab_: radParameters.ab = _ab_
    if _ad_: radParameters.ad = _ad_
    if _as_: radParameters.as_ = _as_
    if _ar_: radParameters.ar = _ar_
    if _aa_: radParameters.aa = _aa_
    
    #print radParameters
    #wrap the object
    radParameters = wrapper.Wrapper(radParameters)
# ---------- end radpar ----------

# ----
number_slider = Slider(60, range=0..100)

# ---- group: sky library
sky = PythonScript(illuminanceValue=Slider(200, range=0..1000))  # -> HBSky
# ---------- sky: Python ----------
import sys
sys.path.append(r"C:\Users\Administrator\Documents\GitHub\honeybee-grasshopper")

from honeybeegrasshopper.radiance.sky.certainIlluminance import SkyWithCertainIlluminanceLevel
from honeybeegrasshopper.wrapper import Wrapper
if _illuminanceValue:
    HBSky = Wrapper(SkyWithCertainIlluminanceLevel(_illuminanceValue))
# ---------- end sky ----------

# ----
python = PythonScript(name="wall", reflect=".55", spec=0, rough=0)  # -> material
# ---------- python: Python ----------
import sys
sys.path.append(r"C:\Users\Administrator\Documents\GitHub\honeybee-grasshopper")

from honeybeegrasshopper.radiance.material.plastic import PlasticMaterial
from honeybeegrasshopper.wrapper import Wrapper

if _name and _reflect:
    material = PlasticMaterial.bySingleReflectValue(_name, _reflect, _spec_, _rough_)
    
    material = Wrapper(material)
# ---------- end python ----------
panel = Panel(python)
sdivide = DivideSurface(Surface=planesrf, UCount=number_slider, VCount=number_slider)  # -> Points, Normals, Parameters
panel_2 = Panel(radpar)
number_slider_2 = Slider(0, range=0..100)
panel_3 = Panel("this")
panel_4 = Panel(sky)

# ---- group: I'm not sure if we need this extra step
python_2 = PythonScript(material=python)  # -> radProp
# ---------- python_2: Python ----------
import sys
sys.path.append(r"C:\Users\Administrator\Documents\GitHub\honeybee-grasshopper")


from honeybeegrasshopper.radiance.properties import RadianceProperties
from honeybeegrasshopper.wrapper import Wrapper

radProp = RadianceProperties(_material_.unwrap(), True) if _material_ else RadianceProperties()
radProp = Wrapper(radProp)
# ---------- end python_2 ----------

# ---- group: analysis recipe
gridbased = PythonScript(HBSky=sky, testPoints=sdivide.Points, radParameters=radpar)  # -> analysisRecipe; inputs testPoints: tree of Point3d, ptsVectors: tree of Vector3d
# ---------- gridbased: Python ----------
import sys
sys.path.append(r"C:\Users\Administrator\Documents\GitHub\honeybee-grasshopper")

from honeybeegrasshopper.radiance.analysisrecipe import GridBasedAnalysisRecipe
from honeybeegrasshopper import wrapper

if _HBSky and _testPoints and ptsVectors_:
    if _radParameters_:
        _radParameters_ = _radParameters_.unwrap()
    
    analysisRecipe = GridBasedAnalysisRecipe(
        _HBSky.unwrap(), _testPoints, ptsVectors_, _radParameters_
        )
    
    analysisRecipe = wrapper.Wrapper(analysisRecipe)
# ---------- end gridbased ----------

# ----
panel_5 = Panel(python_2)
python_3 = PythonScript(geo=planesrf, radProp=python_2)  # -> readMe, HBSrf; inputs geo: GeometryBase, type: Int32
# ---------- python_3: Python ----------
import sys
sys.path.append(r"C:\Users\Administrator\Documents\GitHub\honeybee-grasshopper")


from honeybeegrasshopper.hbsurface import HBSurface
from honeybeegrasshopper.wrapper import Wrapper
from uuid import uuid4

if _geo:
    
    isNameSetByUser = True
    if not name_:
        name_ = "Surface_%s" % uuid4()
        isNameSetByUser = False
        
    isTypeSetByUser = True
    if not _type_:
        isTypeSetByUser = False
    
    radProp_ = radProp_.unwrap() if radProp_ else None
    
    epProp_ = epProp_.unwrap() if epProp_ else None
    
    HBSrf = HBSurface(name_, _geo, _type_, isNameSetByUser,isTypeSetByUser,
                      radProp_, epProp_)
    HBSrf = Wrapper(HBSrf)
# ---------- end python_3 ----------
panel_6 = Panel(gridbased)
panel_7 = Panel(python_3.HBSrf)
python_4 = PythonScript(_recipe=gridbased, _HBObjs=python_3.HBSrf)  # -> ReadMe, Results
rundaylightanalysis = Honeybee_RunDaylightSimulation(overwriteResults=True)  # -> readMe, analysisType, resultsUnit, results, testPts, resultFiles, radGeoFile, studyFolder, done; plug-in component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
